# Dynamo graph Home.dyn (Dynamo 4.0.2.3852)

select_model_element = DSModelElementSelection()  # 1 picked in the model
node_2 = Python(IN[0]=select_model_element)  # PythonNet3
# ---------- node_2.python (75 lines) ----------
# N2: PickDetailComponent
# Input:  1 Detail Component instance (FamilyInstance) được chọn từ model
# Output: FamilySymbol (để dùng cho placement), Point (location), string log
#
# Trích xuất FamilySymbol và Location Point từ 1 Detail Component instance.
# Detail Component là annotation element trong model.

import clr

clr.AddReference("RevitAPI")
from Autodesk.Revit.DB import *

clr.AddReference("RevitServices")
from RevitServices.Persistence import DocumentManager

clr.AddReference("RevitNodes")
import Revit

clr.ImportExtensions(Revit.GeometryConversion)

doc = DocumentManager.Instance.CurrentDBDocument

# --- INPUT ---
detail_instance = UnwrapElement(IN[0])

# --- XỬ LÝ ---
errors = []
family_symbol = None
location_point = None

if detail_instance is None:
    errors.append("Input is null. Please select a Detail Component instance.")
elif not isinstance(detail_instance, FamilyInstance):
    errors.append(
        f"Input is {detail_instance.GetType().Name}, not a FamilyInstance. "
        "Please select a Detail Component instance."
    )
else:
    try:
        # Lấy FamilySymbol
        family_symbol = detail_instance.Symbol  # FamilySymbol
        symbol_name = family_symbol.Name if family_symbol else "null"
    except Exception as e:
        errors.append(f"Cannot get FamilySymbol: {str(e)}")

    try:
        # Lấy Location — có thể là LocationPoint hoặc LocationCurve
        loc = detail_instance.Location
        if loc is None:
            errors.append("Element has no Location.")
        elif isinstance(loc, LocationPoint):
            location_point = loc.Point.ToPoint()
        elif isinstance(loc, LocationCurve):
            # Detail Component có LocationCurve → lấy StartPoint (gốc family)
            curve = loc.Curve
            start = curve.GetEndPoint(0)
            # Đổi sang Dynamo Point
            location_point = start.ToPoint()
        else:
            errors.append(f"Location is {loc.GetType().Name}, unexpected type.")
    except Exception as e:
        errors.append(f"Cannot get Location: {str(e)}")

# --- OUTPUT ---
log_parts = []
if family_symbol:
    log_parts.append(f"FamilySymbol: {family_symbol.FamilyName} / {symbol_name}")
if location_point:
    log_parts.append(
        f"Location: ({location_point.X}, {location_point.Y}, {location_point.Z})"
    )
if errors:
    log_parts.append(f"Errors: {'; '.join(errors)}")

OUT = family_symbol, location_point, "\n".join(log_parts)
# ----------------------------------------
select_model_elements = DSModelElementsSelection()  # 8 picked in the model
node_1 = Python(IN[0]=select_model_elements)  # PythonNet3
# ---------- node_1.python (58 lines) ----------
# N1: GetSelectedElements
# Input:  List<Element> từ Dynamo selection (Select Model Elements)
# Output: List<Element> (chỉ Doors & Windows), string log
#
# Lọc danh sách element được chọn, chỉ giữ lại Doors và Windows.
# Bỏ qua element null hoặc không thuộc category phù hợp.

import clr

clr.AddReference("RevitAPI")
from Autodesk.Revit.DB import *

clr.AddReference("RevitServices")
from RevitServices.Persistence import DocumentManager

doc = DocumentManager.Instance.CurrentDBDocument

# --- INPUT ---
elements = UnwrapElement(IN[0])

# Đảm bảo elements là list
if not hasattr(elements, "__iter__"):
    elements = [elements]

# --- XỬ LÝ ---
result = []
errors = []
count_skipped = 0

for i, el in enumerate(elements):
    if el is None:
        count_skipped += 1
        continue
    try:
        cat = el.Category
        if cat is None:
            count_skipped += 1
            continue

        # So sánh BuiltInCategory trực tiếp (an toàn hơn IntegerValue)
        bic = cat.BuiltInCategory
        if bic == BuiltInCategory.OST_Doors or bic == BuiltInCategory.OST_Windows:
            result.append(el)
        else:
            count_skipped += 1
    except Exception as e:
        errors.append(f"Element #{i}: {str(e)}")
        count_skipped += 1

# --- OUTPUT ---
log_parts = []
log_parts.append(f"Total input: {len(elements)}")
log_parts.append(f"Doors+Windows found: {len(result)}")
log_parts.append(f"Skipped: {count_skipped}")
if errors:
    log_parts.append(f"Errors: {'; '.join(errors)}")

OUT = result, "\n".join(log_parts)
# ----------------------------------------
node_4 = Python(IN[0]=node_1)  # PythonNet3
# ---------- node_4.python (61 lines) ----------
# N4: GetHostWall
# Input:  1 Element hoặc List<Element> — output của N1
# Output: Wall (host wall) hoặc List<Wall>, string log

import clr

clr.AddReference("RevitAPI")
from Autodesk.Revit.DB import *

clr.AddReference("RevitServices")
from RevitServices.Persistence import DocumentManager

doc = DocumentManager.Instance.CurrentDBDocument


def get_host_wall(el):
    if el is None:
        return None, "Element is null."
    try:
        host = el.Host
        if host is None:
            return None, "Unhosted element."
        host_el = doc.GetElement(host.Id)
        if host_el is None:
            return None, "Host element not found."
        if not isinstance(host_el, Wall):
            return None, f"Host is {host_el.GetType().Name}, not a Wall."
        return host_el, None
    except Exception as e:
        return None, str(e)


raw = IN[0]
if hasattr(raw, "__iter__") and not isinstance(raw, str):
    if len(raw) > 0 and hasattr(raw[0], "__iter__") and not isinstance(raw[0], str):
        raw = raw[0]
is_list = hasattr(raw, "__iter__") and not isinstance(raw, str)
inputs = raw if is_list else [raw]
results = []
errors = []

for i, inp in enumerate(inputs):
    el = UnwrapElement(inp)
    val, err = get_host_wall(el)
    results.append(val)
    if err:
        errors.append(f"[{i}]: {err}")

if not is_list:
    results = results[0]

log_parts = []
if not is_list:
    log_parts.append(f"Host Wall: {'ID ' + str(results.Id) if results else 'null'}")
else:
    valid = [r for r in results if r is not None]
    log_parts.append(f"Total: {len(inputs)}, Valid: {len(valid)}")
if errors:
    log_parts.append(f"Errors: {'; '.join(errors)}")

OUT = results, "\n".join(log_parts)
# ----------------------------------------
node_5 = Python(IN[0]=node_4)  # PythonNet3
# ---------- node_5.python (87 lines) ----------
# N5: GetWallThickness
# Input:  1 Wall hoặc List<Wall> — output của N4
# Output: wallThickness (double, mm) hoặc List<double>, string log

import clr

clr.AddReference("RevitAPI")
from Autodesk.Revit.DB import *

clr.AddReference("RevitServices")
from RevitServices.Persistence import DocumentManager

doc = DocumentManager.Instance.CurrentDBDocument


def get_thickness(wall):
    if wall is None:
        return None, "Wall is null."
    # Unwrap nếu là Dynamo wrapper
    unwrapped = UnwrapElement(wall)
    if not isinstance(unwrapped, Wall):
        return (
            None,
            f"Input is {unwrapped.GetType().Name if unwrapped else 'None'}, not Wall.",
        )
    wall = unwrapped
    try:
        bb = wall.get_BoundingBox(None)
        if bb is None:
            return None, "Wall has no BoundingBox."
        loc = wall.Location
        if loc is None or not isinstance(loc, LocationCurve):
            return None, "Wall has no LocationCurve."
        curve = loc.Curve
        dir_vec = (curve.GetEndPoint(1) - curve.GetEndPoint(0)).Normalize()
        wall_dir_xy = XYZ(dir_vec.X, dir_vec.Y, 0).Normalize()
        perp_dir = XYZ(-wall_dir_xy.Y, wall_dir_xy.X, 0)
        minp, maxp = bb.Min, bb.Max
        corners = [
            XYZ(minp.X, minp.Y, minp.Z),
            XYZ(maxp.X, minp.Y, minp.Z),
            XYZ(minp.X, maxp.Y, minp.Z),
            XYZ(maxp.X, maxp.Y, minp.Z),
            XYZ(minp.X, minp.Y, maxp.Z),
            XYZ(maxp.X, minp.Y, maxp.Z),
            XYZ(minp.X, maxp.Y, maxp.Z),
            XYZ(maxp.X, maxp.Y, maxp.Z),
        ]
        proj = [c.DotProduct(perp_dir) for c in corners]
        val = (max(proj) - min(proj)) * 304.8
        if val <= 0:
            return None, "Invalid thickness (<= 0)."
        return val, None
    except Exception as e:
        return None, str(e)


raw = IN[0]
if hasattr(raw, "__iter__") and not isinstance(raw, str):
    if len(raw) > 0 and hasattr(raw[0], "__iter__") and not isinstance(raw[0], str):
        raw = raw[0]
is_list = hasattr(raw, "__iter__") and not isinstance(raw, str)
inputs = raw if is_list else [raw]
results = []
errors = []

for i, inp in enumerate(inputs):
    val, err = get_thickness(inp)
    results.append(val)
    if err:
        errors.append(f"[{i}]: {err}")

if not is_list:
    results = results[0]

log_parts = []
if not is_list:
    log_parts.append(
        f"Thickness: {results:.1f} mm" if results is not None else "Thickness: null"
    )
else:
    valid = [r for r in results if r is not None]
    log_parts.append(f"Total: {len(inputs)}, Valid: {len(valid)}")
if errors:
    log_parts.append(f"Errors: {'; '.join(errors)}")

OUT = results, "\n".join(log_parts)
# ----------------------------------------
node_8 = Python(IN[0]=node_2, IN[1]=node_5)  # PythonNet3
# ---------- node_8.python (115 lines) ----------
# N8: GetOrCreateType
# Input:  FamilySymbol (original — từ N2), wallThickness_mm (double hoặc List<double> — từ N5)
# Output: ElementId (FamilySymbol) hoặc List<ElementId>, string log
#
# Width (Type parameter) của Detail = độ dày tường.
# Nếu type với Width này đã tồn tại → trả về ElementId của nó.
# Nếu chưa → duplicate, đặt tên `<Gốc>_T<wallThickness>`, set Width = wall thickness.

import clr

clr.AddReference("RevitAPI")
from Autodesk.Revit.DB import *

clr.AddReference("RevitServices")
from RevitServices.Persistence import DocumentManager
from RevitServices.Transactions import TransactionManager

doc = DocumentManager.Instance.CurrentDBDocument

# --- INPUT ---
raw_orig = IN[0]
if hasattr(raw_orig, "__iter__") and not isinstance(raw_orig, str):
    raw_orig = raw_orig[0] if len(raw_orig) > 0 else None
if isinstance(raw_orig, ElementId):
    orig_sym = doc.GetElement(raw_orig)
else:
    orig_sym = UnwrapElement(raw_orig)

raw_thick = IN[1]

# N5/N6/N7 output là [list_values, log_string] → extract list_values
if hasattr(raw_thick, "__iter__") and not isinstance(raw_thick, str):
    if len(raw_thick) > 0:
        first = raw_thick[0]
        # Nếu first là list → đó là [values, log]
        if hasattr(first, "__iter__") and not isinstance(first, str):
            raw_thick = first
        # Nếu first là string → đó là log, cần tìm phần tử số
        elif isinstance(first, str):
            for item in raw_thick:
                if not isinstance(item, str):
                    raw_thick = item
                    break
            else:
                raw_thick = None

is_list = hasattr(raw_thick, "__iter__") and not isinstance(raw_thick, str)
thicknesses = raw_thick if is_list else [raw_thick]

results = []
errors = []

if orig_sym is None:
    errors.append("Original FamilySymbol is null.")
    results = [None] * len(thicknesses)
else:
    cache = {}
    TransactionManager.Instance.EnsureInTransaction(doc)

    for i, t in enumerate(thicknesses):
        try:
            wt = float(t)
            if wt <= 0:
                errors.append(f"[{i}]: Invalid thickness {wt}")
                results.append(None)
                continue

            key = round(wt, 1)
            if key in cache:
                results.append(cache[key])
                continue

            tn = f"{orig_sym.Name}_T{wt:.0f}"
            existing = None
            for sid in orig_sym.Family.GetFamilySymbolIds():
                s = doc.GetElement(sid)
                if s is not None and s.Name == tn:
                    existing = s
                    break

            if existing is not None:
                cache[key] = existing.Id
                results.append(existing.Id)
            else:
                new_sym = orig_sym.Duplicate(tn)
                if new_sym is None:
                    errors.append(f"[{i}]: Duplicate returned null.")
                    results.append(None)
                else:
                    wp = new_sym.LookupParameter("Width")
                    if wp is not None:
                        wp.Set(wt / 304.8)
                    cache[key] = new_sym.Id
                    results.append(new_sym.Id)
        except Exception as ex:
            errors.append(f"[{i}]: {str(ex)}")
            results.append(None)

    TransactionManager.Instance.TransactionTaskDone()

if not is_list:
    results = results[0]

log_parts = []
if not is_list:
    log_parts.append(
        f"Type: {orig_sym.Name}_T{float(raw_thick):.0f}" if results else "Type: null"
    )
else:
    valid = [r for r in results if r is not None]
    log_parts.append(f"Total: {len(thicknesses)}, Created/Found: {len(valid)}")
if errors:
    log_parts.append(f"Errors: {'; '.join(errors[:3])}")

OUT = results, "\n".join(log_parts)
# ----------------------------------------
node_7 = Python(IN[0]=node_1)  # PythonNet3
# ---------- node_7.python (58 lines) ----------
# N7: GetLocationPoint
# Input:  1 Element hoặc List<Element> — output của N1
# Output: Point (Dynamo Point) hoặc List<Point>, string log

import clr

clr.AddReference("RevitAPI")
from Autodesk.Revit.DB import *

clr.AddReference("RevitNodes")
import Revit

clr.ImportExtensions(Revit.GeometryConversion)


def get_loc_point(el):
    if el is None:
        return None, "Element is null."
    try:
        loc = el.Location
        if loc is None:
            return None, "Element has no Location."
        if not isinstance(loc, LocationPoint):
            return None, f"Location is {loc.GetType().Name}, not LocationPoint."
        return loc.Point.ToPoint(), None
    except Exception as e:
        return None, str(e)


raw = IN[0]
if hasattr(raw, "__iter__") and not isinstance(raw, str):
    if len(raw) > 0 and hasattr(raw[0], "__iter__") and not isinstance(raw[0], str):
        raw = raw[0]
is_list = hasattr(raw, "__iter__") and not isinstance(raw, str)
inputs = raw if is_list else [raw]
results = []
errors = []

for i, inp in enumerate(inputs):
    el = UnwrapElement(inp)
    val, err = get_loc_point(el)
    results.append(val)
    if err:
        errors.append(f"[{i}]: {err}")

if not is_list:
    results = results[0]

log_parts = []
if not is_list:
    log_parts.append(f"Point: OK" if results is not None else "Point: null")
else:
    valid = [r for r in results if r is not None]
    log_parts.append(f"Total: {len(inputs)}, Valid: {len(valid)}")
if errors:
    log_parts.append(f"Errors: {'; '.join(errors)}")

OUT = results, "\n".join(log_parts)
# ----------------------------------------
node_6 = Python(IN[0]=node_4)  # PythonNet3
# ---------- node_6.python (68 lines) ----------
# N6: GetWallOrientation
# Input:  1 Wall hoặc List<Wall> — output của N4
# Output: Vector (Dynamo Vector) hoặc List<Vector>, string log

import clr

clr.AddReference("RevitAPI")
from Autodesk.Revit.DB import *

clr.AddReference("RevitNodes")
import Revit

clr.ImportExtensions(Revit.GeometryConversion)


def get_orientation(wall):
    if wall is None:
        return None, "Wall is null."
    # Unwrap nếu là Dynamo wrapper
    unwrapped = UnwrapElement(wall)
    if not isinstance(unwrapped, Wall):
        return (
            None,
            f"Input is {unwrapped.GetType().Name if unwrapped else 'None'}, not Wall.",
        )
    wall = unwrapped
    try:
        loc = wall.Location
        if loc is None or not isinstance(loc, LocationCurve):
            return None, "Wall has no LocationCurve."
        curve = loc.Curve
        p0 = curve.GetEndPoint(0)
        p1 = curve.GetEndPoint(1)
        vec = (p1 - p0).Normalize()
        result = XYZ(vec.X, vec.Y, 0).Normalize().ToVector()
        return result, None
    except Exception as e:
        return None, str(e)


raw = IN[0]
if hasattr(raw, "__iter__") and not isinstance(raw, str):
    if len(raw) > 0 and hasattr(raw[0], "__iter__") and not isinstance(raw[0], str):
        raw = raw[0]
is_list = hasattr(raw, "__iter__") and not isinstance(raw, str)
inputs = raw if is_list else [raw]
results = []
errors = []

for i, inp in enumerate(inputs):
    val, err = get_orientation(inp)
    results.append(val)
    if err:
        errors.append(f"[{i}]: {err}")

if not is_list:
    results = results[0]

log_parts = []
if not is_list:
    log_parts.append(f"Dir: OK" if results is not None else "Dir: null")
else:
    valid = [r for r in results if r is not None]
    log_parts.append(f"Total: {len(inputs)}, Valid: {len(valid)}")
if errors:
    log_parts.append(f"Errors: {'; '.join(errors)}")

OUT = results, "\n".join(log_parts)
# ----------------------------------------
node_3 = Python(IN[0]=node_1)  # PythonNet3
# ---------- node_3.python (67 lines) ----------
# N3: GetWidth
# Input:  1 Element hoặc List<Element> — output của N1
# Output: widthValue (double, mm) hoặc List<double>, string log

import clr

clr.AddReference("RevitAPI")
from Autodesk.Revit.DB import *

clr.AddReference("RevitServices")
from RevitServices.Persistence import DocumentManager

doc = DocumentManager.Instance.CurrentDBDocument


def get_width(el):
    """Lấy Width (Type parameter) từ 1 element. Trả về (value_mm, error_str)."""
    if el is None:
        return None, "Element is null."
    try:
        sym = el.Symbol
        if sym is None:
            return None, "Element has no Symbol."
        param = sym.LookupParameter("Width")
        if param is None:
            return None, "Cannot find 'Width' parameter on Symbol."
        return param.AsDouble() * 304.8, None
    except Exception as e:
        return None, str(e)


# --- INPUT ---
raw = IN[0]

# N1 output có thể là [list_elements, log] → lấy phần tử đầu
if hasattr(raw, "__iter__") and not isinstance(raw, str):
    if len(raw) > 0 and hasattr(raw[0], "__iter__") and not isinstance(raw[0], str):
        raw = raw[0]

is_list = hasattr(raw, "__iter__") and not isinstance(raw, str)
inputs = raw if is_list else [raw]
results = []
errors = []

for i, inp in enumerate(inputs):
    el = UnwrapElement(inp)
    val, err = get_width(el)
    results.append(val)
    if err:
        errors.append(f"[{i}]: {err}")

if not is_list:
    results = results[0]

# --- OUTPUT ---
log_parts = []
if not is_list:
    log_parts.append(
        f"Width: {results:.1f} mm" if results is not None else "Width: null"
    )
else:
    valid = [r for r in results if r is not None]
    log_parts.append(f"Total: {len(inputs)}, Valid: {len(valid)}")
if errors:
    log_parts.append(f"Errors: {'; '.join(errors)}")

OUT = results, "\n".join(log_parts)
# ----------------------------------------
node_9 = Python(IN[0]=node_8, IN[1]=node_7, IN[2]=node_6, IN[3]=node_3)  # PythonNet3
# ---------- node_9.python (188 lines) ----------
# N9: CreateAnnotation
# Input:  FamilySymbol (ElementId — từ N8), locationPoint (Dynamo Point — từ N7),
#         wallDirection (Dynamo Vector — từ N6), widthValue_mm (từ N3)
# Output: FamilyInstance (annotation) hoặc List<FamilyInstance>, string log
#
# Tạo line-based Detail Component. Length tự động từ Line (không set parameter).

import clr

clr.AddReference("RevitAPI")
from Autodesk.Revit.DB import *

clr.AddReference("RevitServices")
from RevitServices.Persistence import DocumentManager
from RevitServices.Transactions import TransactionManager

clr.AddReference("RevitNodes")
import Revit

clr.ImportExtensions(Revit.GeometryConversion)

doc = DocumentManager.Instance.CurrentDBDocument


def create_annotation(family_symbol, location_pt, wall_dir_vec, width_mm):
    """Tạo 1 annotation. Trả về (FamilyInstance, error_str)."""
    if family_symbol is None:
        return None, "FamilySymbol is null."
    if location_pt is None:
        return None, "Location point is null."
    if wall_dir_vec is None:
        return None, "Wall direction is null."
    if width_mm is None or width_mm <= 0:
        return None, f"Invalid width: {width_mm}"

    try:
        annotation_length = width_mm + 40.0  # mm
        half = annotation_length / 2.0 / 304.8  # feet

        view = doc.ActiveView
        elev = view.GenLevel.Elevation if view.GenLevel else 0.0

        center_xyz = location_pt.ToXyz()
        dir_xyz = wall_dir_vec.ToXyz()

        sp = center_xyz - dir_xyz.Multiply(half)
        ep = center_xyz + dir_xyz.Multiply(half)
        sp = XYZ(sp.X, sp.Y, elev)
        ep = XYZ(ep.X, ep.Y, elev)
        line = Line.CreateBound(sp, ep)

        annotation = doc.Create.NewFamilyInstance(line, family_symbol, view)
        if annotation is None:
            return None, "NewFamilyInstance returned null."
        return annotation, None
    except Exception as e:
        return None, str(e)


def unwrap_deep(obj):
    """Unwrap nested lists/objects đến khi ra object thực tế."""
    if obj is None:
        return None
    # Nếu là list, lấy phần tử đầu và tiếp tục unwrap
    while hasattr(obj, "__iter__") and not isinstance(obj, str):
        if len(obj) > 0:
            obj = obj[0]
        else:
            return None
    return obj


# --- INPUT ---
raw_sym = IN[0]

# N8 output là [list_ElementId, log_string] → extract list_ElementId
if hasattr(raw_sym, "__iter__") and not isinstance(raw_sym, str):
    if len(raw_sym) > 0:
        first = raw_sym[0]
        if hasattr(first, "__iter__") and not isinstance(first, str):
            raw_sym = first
        elif isinstance(first, str):
            for item in raw_sym:
                if isinstance(item, (int, float)) or (
                    hasattr(item, "__iter__") and not isinstance(item, str)
                ):
                    raw_sym = item
                    break
            else:
                raw_sym = None

# Convert sang list of FamilySymbol
family_symbols = []
if isinstance(raw_sym, ElementId):
    family_symbols = [doc.GetElement(raw_sym)]
elif isinstance(raw_sym, list):
    for item in raw_sym:
        # Unwrap nested lists đến khi ra ElementId
        while (
            hasattr(item, "__iter__")
            and not isinstance(item, str)
            and not isinstance(item, ElementId)
        ):
            if len(item) > 0:
                item = item[0]
            else:
                item = None
                break
        if isinstance(item, ElementId):
            family_symbols.append(doc.GetElement(item))
        else:
            family_symbols.append(UnwrapElement(item))
else:
    family_symbols = [UnwrapElement(raw_sym)]


# Helper: unwrap N1-style output [list, log]
def unwrap_n1_output(raw):
    if hasattr(raw, "__iter__") and not isinstance(raw, str):
        if len(raw) > 0 and hasattr(raw[0], "__iter__") and not isinstance(raw[0], str):
            return raw[0]
    return raw


raw_pt = unwrap_n1_output(IN[1])
raw_vec = unwrap_n1_output(IN[2])
raw_width = unwrap_n1_output(IN[3])

is_list_pt = hasattr(raw_pt, "__iter__") and not isinstance(raw_pt, str)
pts = raw_pt if is_list_pt else [raw_pt]

is_list_vec = hasattr(raw_vec, "__iter__") and not isinstance(raw_vec, str)
vecs = raw_vec if is_list_vec else [raw_vec]

is_list_w = hasattr(raw_width, "__iter__") and not isinstance(raw_width, str)
widths = raw_width if is_list_w else [raw_width]

is_list = is_list_pt or is_list_vec or is_list_w
count = max(len(pts), len(vecs), len(widths))

results = []
errors = []

TransactionManager.Instance.EnsureInTransaction(doc)

for i in range(count):
    pt = pts[i] if i < len(pts) else None
    vec = vecs[i] if i < len(vecs) else None
    w = widths[i] if i < len(widths) else None

    # Nếu width vẫn là list (từ N3), unwrap sâu
    if w is not None and hasattr(w, "__iter__") and not isinstance(w, str):
        while hasattr(w, "__iter__") and not isinstance(w, str):
            if len(w) > 0:
                w = w[0]
            else:
                w = None
                break

    # Lấy FamilySymbol cho element thứ i
    sym_i = family_symbols[i] if i < len(family_symbols) else None

    # Đảm bảo sym_i là FamilySymbol, không phải list
    if sym_i is not None:
        sym_i = unwrap_deep(sym_i)
        if isinstance(sym_i, ElementId):
            sym_i = doc.GetElement(sym_i)

    anno, err = create_annotation(sym_i, pt, vec, w)
    results.append(anno)
    if err:
        errors.append(f"[{i}]: {err}")

TransactionManager.Instance.TransactionTaskDone()

if not is_list:
    results = results[0] if results else None

log_parts = []
if not is_list:
    log_parts.append(f"Created: {results.Id}" if results else "Failed")
else:
    valid = [r for r in results if r is not None]
    log_parts.append(f"Total: {count}, Created: {len(valid)}")
if errors:
    log_parts.append(f"Errors: {'; '.join(errors[:5])}")

OUT = results, "\n".join(log_parts)
# ----------------------------------------
node_10 = Python(IN[0]=node_9, IN[1]=node_3, IN[2]=node_5)  # PythonNet3
# ---------- node_10.python (143 lines) ----------
# N10: SanityCheck
# Input:  Annotation (FamilyInstance hoặc List<FamilyInstance> — từ N9),
#         widthValue_mm (từ N3), wallThickness_mm (từ N5)
# Output: bool (Pass/Fail) hoặc List<bool>, string log
#
# Kiểm tra độc lập: đo Width (Type) và Length (hình học) của annotation.

import clr

clr.AddReference("RevitAPI")
from Autodesk.Revit.DB import *

clr.AddReference("RevitServices")
from RevitServices.Persistence import DocumentManager

doc = DocumentManager.Instance.CurrentDBDocument


def check_annotation(annotation, expected_width, expected_length):
    """Kiểm tra 1 annotation. Trả về (passed: bool, detail: str)."""
    if annotation is None:
        return False, "Annotation is null."
    try:
        # Check 1: Width (Type) = wall thickness
        sym = annotation.Symbol
        if sym is None:
            return False, "Annotation has no Symbol."
        width_param = sym.LookupParameter("Width")
        if width_param is None:
            return False, "Cannot find 'Width' (Type) parameter."
        actual_width_mm = width_param.AsDouble() * 304.8
        if abs(actual_width_mm - expected_width) > 1.0:
            return (
                False,
                f"Width mismatch: expected {expected_width:.1f}, got {actual_width_mm:.1f}",
            )

        # Check 2: Length (hình học) = width cửa + 40mm
        loc = annotation.Location
        if loc is None:
            return False, "Annotation has no Location."
        if not isinstance(loc, LocationCurve):
            return False, f"Location is {loc.GetType().Name}, not LocationCurve."
        actual_length_mm = loc.Curve.Length * 304.8
        if abs(actual_length_mm - expected_length) > 1.0:
            return (
                False,
                f"Length mismatch: expected {expected_length:.1f}, got {actual_length_mm:.1f}",
            )

        return True, "OK"
    except Exception as e:
        return False, f"Error: {str(e)}"


def unwrap_deep(obj):
    """Unwrap nested lists đến khi ra object thực tế."""
    if obj is None:
        return None
    while hasattr(obj, "__iter__") and not isinstance(obj, str):
        if len(obj) > 0:
            obj = obj[0]
        else:
            return None
    return obj


def extract_list_from_output(raw):
    """Extract list từ output [list, log_string] của các node."""
    if raw is None:
        return []
    # Nếu là list, lấy phần tử đầu tiên là list
    if hasattr(raw, "__iter__") and not isinstance(raw, str):
        if len(raw) > 0:
            first = raw[0]
            # Nếu first là list → đó là list values
            if hasattr(first, "__iter__") and not isinstance(first, str):
                return first
            # Nếu first là string → log, tìm phần tử là list
            elif isinstance(first, str):
                for item in raw:
                    if hasattr(item, "__iter__") and not isinstance(item, str):
                        return item
    # Nếu là list đơn thuần
    if hasattr(raw, "__iter__") and not isinstance(raw, str):
        return raw
    # Nếu là single value
    return [raw]


# --- INPUT ---
raw_anno = extract_list_from_output(IN[0])
annos = [unwrap_deep(a) for a in raw_anno] if raw_anno else []

raw_width = extract_list_from_output(IN[1])
widths = [unwrap_deep(w) for w in raw_width] if raw_width else []

raw_thickness = extract_list_from_output(IN[2])
thicknesses = [unwrap_deep(t) for t in raw_thickness] if raw_thickness else []

is_list = len(annos) > 1 or len(widths) > 1 or len(thicknesses) > 1
count = max(len(annos), len(widths), len(thicknesses))

results = []
errors = []

for i in range(count):
    anno = annos[i] if i < len(annos) else None
    w = widths[i] if i < len(widths) else None
    t = thicknesses[i] if i < len(thicknesses) else None

    if anno is None:
        results.append(False)
        errors.append(f"[{i}]: Annotation is null.")
        continue
    if w is None or w <= 0:
        results.append(False)
        errors.append(f"[{i}]: Invalid width.")
        continue
    if t is None or t <= 0:
        results.append(False)
        errors.append(f"[{i}]: Invalid thickness.")
        continue

    expected_length = w + 40.0
    passed, detail = check_annotation(anno, t, expected_length)
    results.append(passed)
    if not passed:
        errors.append(f"[{i}]: {detail}")

if not is_list:
    results = results[0] if results else False

log_parts = []
if not is_list:
    log_parts.append("PASSED" if results else "FAILED")
else:
    passed_count = sum(1 for r in results if r)
    log_parts.append(f"Total: {count}, Passed: {passed_count}, Failed: {len(errors)}")
if errors:
    log_parts.append(f"Errors: {'; '.join(errors[:5])}")

OUT = results, "\n".join(log_parts)
# ----------------------------------------
